# Grasshopper definition Estudando edifício ortogonal.gh (Grasshopper 0.9.76)
# plug-ins: GhVa10, LunchBox

# ---- group: Projeção do edifício
comprimento_do_edifício = Slider(90, range=0..100)
largura_do_edifício = Slider(20, range=0..100)
pt = ConstructPoint(XCoordinate=0, YCoordinate=0, ZCoordinate=0)
rectangle = Rectangle(Plane=pt, XSize=comprimento_do_edifício, YSize=largura_do_edifício, Radius=0)  # -> Rectangle, Length

# ----
distancia_entre_as_caixas = Slider(0.2, range=0..1)
tamanho_da_nervura = Slider(1, range=0..1)
altura_da_laje = Slider(0.98, range=0..1)

# ---- group: Volumetria
número_de_pavimentos = Slider(5, range=0..10)
pé_direito = Slider(5, range=0..10)
projeção_do_edifício = Curve(rectangle.Rectangle)

# ----
expression = Expression(x=altura_da_laje, Expression="x*-1")
division = Division(A=largura_do_edifício, B=tamanho_da_nervura)
division_2 = Division(A=comprimento_do_edifício, B=tamanho_da_nervura)
Z = UnitZ(Factor=expression)
int = Integer(division)
int_2 = Integer(division_2)
series = Series(Start=0, Step=pé_direito, Count=número_de_pavimentos)
extr = Extrude(Base=rectangle.Rectangle, Direction=Z)
grid = GridStructure(Surface=rectangle.Rectangle, UDivisions=10, VDivisions=10)  # -> StructureLines, StructureNodes
Z_2 = UnitZ(Factor=series)
Z_3 = UnitZ(Factor=pé_direito)
cap = CapHoles(Brep=extr)
move = Move(Geometry=projeção_do_edifício, Motion=Z_2)  # -> Geometry, Transform
extr_2 = Extrude(Base=move.Geometry, Direction=Z_3)
cap_2 = CapHoles(Brep=extr_2)

# ---- group: Eixos estruturais
balanço_oeste = Slider(1.25, range=0..10, expression="x*-1")
balanço_sul = Slider(1.25, range=0..10, expression="x*-1")
balanço_leste = Slider(2.5, range=0..10, expression="x*-1")
balanço_norte = Slider(1.25, range=0..10, expression="x*-1")

# ----
vigas = Panel("""0
2""")
explode = Explode(Curve=projeção_do_edifício, Recursive=True)  # -> Segments, Vertices
offset = Offset(
    Curve=explode.Segments,
    Distance=[balanço_oeste, balanço_sul, balanço_leste, balanço_norte],
    Plane=PlaneXY(0, 0, 0),
    Corners=1)  # -> flatten(Curve)
item = ListItem(List=offset, Index=vigas, Wrap=True)
Z_4 = UnitZ(Factor=pé_direito)
mcx = MultipleCurves(Curves=offset)  # -> Points, IndexA, IndexB, ParamA, ParamB
move_2 = Move(Geometry=item, Motion=Z_4)  # -> Geometry, Transform
column = Column(Position=mcx.Points, Option=null)
divdist = DivideDistance(Curve=item, Distance=pé_direito)  # -> Points, Tangents, Parameters
column_2 = Column(Position=divdist.Points, Option=null)
beam = Beam(Curve=[move_2.Geometry, item], Option=null)
